# Grasshopper definition CreateFEMesh.gh (Grasshopper 0.9.76)
# plug-ins: BH.UI.Grasshopper

# ----
# Adapter
path = FilePath()
bhom = BHoMObject()

constantthickness = ConstantThickness(
    Thickness=0.2,
    Type="{ \"_t\" : \"System.Enum\", \"TypeName\" : { \"_t\" : \"System.Type\", \"Name\" : \"BH.oM.Structure.SurfaceProperties.PanelType\" }, \"Value\" : \"Undefined\" }",
    Component="{ .ConstantThickness")

# ----
# Create BHoM Element
mesh = Mesh(flatten(Tree({0;0}: [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], {0;1}: [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], {0;2}: [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], {0;3}: [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], {0;4}: [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], {0;5}: [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]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)))
femesh = FEMesh(Mesh=mesh, Property=constantthickness, Component="{ .FEMesh")

# ----
# Push
bhom_2 = BHoMObject(femesh)
push = Push(Adapter=bhom, Objects=bhom_2, Active=Toggle(False), Component="{ .Push")  # -> Objects, Success

combinetextfiles = CombineTextFiles(Active=push.Success, Component="{ .CombineTextFiles")
