# Grasshopper definition CreatePlanarPanels.gh (Grasshopper 0.9.76)
# plug-ins: BH.UI.Grasshopper

# ----
# Adapter
path = FilePath()
bhom = BHoMObject()

brep = Brep([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])

# ----
# Create BHoM Element
edges = BrepEdges(Brep=brep)  # -> Naked, Interior, NonManifold
join = JoinCurves(Curves=edges.Naked, Preserve=False)  # -> flatten(Curves)

crv = Curve(join)

panel = Panel(Outlines=crv, Component="{ .Panel")

# ----
# Push
toggle = BooleanToggle(False)
bhom_2 = BHoMObject(panel)
push = Push(Adapter=bhom, Objects=bhom_2, Active=toggle, Component="{ .Push")  # -> Objects, Success
