# Grasshopper definition CreateAreaUniformlyDistributedLoads.gh (Grasshopper 0.9.76)
# plug-ins: BH.UI.Grasshopper

# ----
# Adapter
path = FilePath()
bhom = BHoMObject()

# ----
# Create Loadcase
number_slider = Slider(1, range=0..10)
loadcase = Loadcase(
    Name="Loadcase1",
    Number=number_slider,
    Nature="{ \"_t\" : \"System.Enum\", \"TypeName\" : { \"_t\" : \"System.Type\", \"Name\" : \"BH.oM.Structure.Loads.LoadNature\" }, \"Value\" : \"Other\" }",
    Component="{ .Loadcase")

# ----
# Push
toggle = BooleanToggle(False)
bhom_2 = BHoMObject([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])
push = Push(Adapter=bhom, Objects=bhom_2, Active=toggle, Component="{ .Push")  # -> Objects, Success

bhom_3 = BHoMObject(push.Objects)
bhom_4 = BHoMObject(loadcase)

# ----
# Create BHoM Load
number_slider_2 = Slider(6, range=0..10)
vec = VectorXYZ(XComponent=Slider(9, range=0..10), YComponent=Slider(1, range=0..10), ZComponent=number_slider_2)  # -> Vector, Length
loadaxis = LoadAxis(
    {"Global": 0, "Local": 1}, selected="Global",
    TypeName="BH.oM.Structure.Loads.LoadAxis, Structure_oM, Version=2.0.0.0, Culture=neutral, PublicKeyToken=null")
vec_2 = Vector(vec.Vector)
areauniformalydistributedload = AreaUniformalyDistributedLoad(
    Loadcase=bhom_4,
    Pressure=vec_2,
    Objects=bhom_3,
    Axis=loadaxis,
    Projected=False,
    Name="Global - Area",
    Component="{ .AreaUniformalyDistributedLoad")

# ----
# Push
bhom_5 = BHoMObject(areauniformalydistributedload)
push_2 = Push(Adapter=bhom, Objects=bhom_5, Active=push.Success, Component="{ .Push")  # -> Objects, Success
