# Grasshopper definition CreateBarUniformlyDistributedLoads.gh (Grasshopper 0.9.76)
# plug-ins: Alligator

# ----
# Create Adapter Here
# File Path to reference model file
# Plug structural adapter in to this component.
path = FilePath("C:\Users\pnugent\Desktop\wgsdgh.mdl")
bhom = BHoMObject()

# ----
# Create Loadcase
panel = Panel("Loadcase1")
loadcase = Loadcase(
    Name=panel,
    Number=Slider(1, range=0..10),
    Nature="{ \"_t\" : \"System.Enum\", \"TypeName\" : { \"_t\" : \"System.Type\", \"Name\" : \"BH.oM.Structure.Loads.LoadNature\" }, \"Value\" : \"Other\" }",
    Component="{ .Loadcase")

# ----
# Push Bars
bhom_2 = BHoMObject([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])

push = Push(Adapter=bhom, Objects=bhom_2, Active=Toggle(False), Component="{ .Push")  # -> Objects, Success

bool = Boolean(push.Success)

# ----
# Create UniformlyDistributedBarLoad
number_slider = Slider(8, range=0..10)
vec = VectorXYZ(XComponent=Slider(2, range=0..10), YComponent=Slider(6, range=0..10), ZComponent=number_slider)  # -> Vector, Length
vec_2 = VectorXYZ(XComponent=Slider(5, range=0..10), YComponent=Slider(2, range=0..10), ZComponent=Slider(9, range=0..10))  # -> Vector, Length
loadaxis = LoadAxis(
    {"Global": 0, "Local": 1}, selected="Global",
    TypeName="BH.oM.Structure.Loads.LoadAxis, Structure_oM, Version=1.0.0.0, Culture=neutral, PublicKeyToken=null")

bhom_3 = BHoMObject(loadcase)
bhom_4 = BHoMObject(push.Objects)
vec_3 = Vector(vec.Vector)
vec_4 = Vector(vec_2.Vector)
baruniformlydistributedload = BarUniformlyDistributedLoad(
    Loadcase=bhom_3,
    Objects=bhom_4,
    Force=vec_3,
    Moment=vec_4,
    Axis=loadaxis,
    Projected=False,
    Name="UniformlyDistributed",
    Component="{ .BarUniformlyDistributedLoad")
bhom_5 = BHoMObject(baruniformlydistributedload)
push_2 = Push(Adapter=bhom, Objects=bhom_5, Active=bool, Component="{ .Push")  # -> Objects, Success
