# Grasshopper definition CreateGravityLoads.gh (Grasshopper 0.9.76)
# plug-ins: BH.UI.Grasshopper

# ----
# Adapter
path = FilePath()
bhom = BHoMObject()

# ----
# Create Loadcase
number_slider = Slider(1, range=0..10)
loadcase = Loadcase(
    Name="Loadcase1",
    Number=number_slider,
    Nature="{ \"_t\" : \"System.Enum\", \"TypeName\" : { \"_t\" : \"System.Type\", \"Name\" : \"BH.oM.Structure.Loads.LoadNature\" }, \"Value\" : \"Other\" }",
    Component="{ .Loadcase")

# ----
# Push
toggle = BooleanToggle(False)
bhom_2 = BHoMObject(flatten(Tree({0}: [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], {0;0}: [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])))
push = Push(Adapter=bhom, Objects=bhom_2, Active=toggle, Component="{ .Push")  # -> Objects, Success

bhom_3 = BHoMObject(loadcase)
bhom_4 = BHoMObject(push.Objects)

# ----
# Create Load
number_slider_2 = Slider(-1, range=-1..1)
vec = VectorXYZ(XComponent=0, YComponent=0, ZComponent=number_slider_2)  # -> Vector, Length
vec_2 = Vector(vec.Vector)
gravityload = GravityLoad(Loadcase=bhom_3, Direction=vec_2, Objects=bhom_4, Name="GravityLoad", Component="{ .GravityLoad")

# ----
# Push
bhom_5 = BHoMObject(gravityload)
push_2 = Push(Adapter=bhom, Objects=bhom_5, Active=push.Success, Component="{ .Push")  # -> Objects, Success
