# Grasshopper definition CreatePointForces.gh (Grasshopper 0.9.76)
# plug-ins: BH.UI.Grasshopper

# ----
# Adapter
path = FilePath()
bhom = BHoMObject()

# ----
# Create Loadcase
panel = Panel("Loadcase1")
loadcase = Loadcase(
    Name=panel,
    Number=Slider(1, range=0..10),
    Nature="{ \"_t\" : \"System.Enum\", \"TypeName\" : { \"_t\" : \"System.Type\", \"Name\" : \"BH.oM.Structure.Loads.LoadNature\" }, \"Value\" : \"Other\" }",
    Component="{ .Loadcase")

# ----
# Push
toggle = BooleanToggle(False)
bhom_2 = BHoMObject([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])
push = Push(Adapter=bhom, Objects=bhom_2, Active=toggle, Component="{ .Push")  # -> Objects, Success

igeometry = IGeometry(Obj=bhom_2, Component="{ .IGeometry")
bhomgeo = BHoMGeometry(igeometry)
bhomgeo_2 = BHoMGeometry(["{ \"_t\" : \"BH.oM.Geometry.Point\", \"X\" : 0.0, \"Y\" : 85.425527846168251, \"Z\" : -1.578374876945916 }", "{ \"_t\" : \"BH.oM.Geometry.Point\", \"X\" : 0.0, \"Y\" : 86.137494868873731, \"Z\" : 0.43886502071964006 }", "{ \"_t\" : \"BH.oM.Geometry.Point\", \"X\" : 0.0, \"Y\" : 86.968123062030145, \"Z\" : 2.218782577483366 }", "{ \"_t\" : \"BH.oM.Geometry.Point\", \"X\" : 0.0, \"Y\" : 88.273395936990212, \"Z\" : 3.5240554524434318 }", "{ \"_t\" : \"BH.oM.Geometry.Point\", \"X\" : 0.0, \"Y\" : 89.341346471048439, \"Z\" : 3.880038963796177 }", "{ \"_t\" : \"BH.oM.Geometry.Point\", \"X\" : 0.0, \"Y\" : 90.40929700510668, \"Z\" : 3.0494107706397715 }", "{ \"_t\" : \"BH.oM.Geometry.Point\", \"X\" : 0.0, \"Y\" : 91.121264027812174, \"Z\" : 1.3881543843269606 }", "{ \"_t\" : \"BH.oM.Geometry.Point\", \"X\" : 0.0, \"Y\" : 91.477247539164907, \"Z\" : -0.86640785424042543 }", "{ \"_t\" : \"BH.oM.Geometry.Point\", \"X\" : 0.0, \"Y\" : 91.951892220968574, \"Z\" : -3.1209700928078119 }", "{ \"_t\" : \"BH.oM.Geometry.Point\", \"X\" : 0.0, \"Y\" : 92.782520414124974, \"Z\" : -4.4262429677678776 }"])
bhomgeo_3 = BHoMGeometry(bhomgeo_2)
bhom_3 = BHoMObject(bhom_2)
bhom_4 = BHoMObject(loadcase)
bhom_5 = BHoMObject(push.Objects)
null = NullItem(Item=bhomgeo_3)  # -> NullFlags, InvalidFlags, Description

# ----
# Create BHoM Load
number_slider = Slider(2, range=0..10)
vec = VectorXYZ(XComponent=Slider(7, range=0..10), YComponent=Slider(3, range=0..10), ZComponent=Slider(6, range=0..10))  # -> Vector, Length
vec_2 = VectorXYZ(XComponent=number_slider, YComponent=Slider(6, range=0..10), ZComponent=Slider(8, range=0..10))  # -> Vector, Length
vec_3 = Vector(vec_2.Vector)
loadaxis = LoadAxis(
    {"Global": 0, "Local": 1}, selected="Global",
    TypeName="BH.oM.Structure.Loads.LoadAxis, Structure_oM, Version=2.0.0.0, Culture=neutral, PublicKeyToken=null")
vec_4 = Vector(vec.Vector)
pointforce = PointForce(Loadcase=bhom_4, Objects=bhom_5, Force=vec_3, Moment=vec_4, Axis=loadaxis, Name="PointForce", Component="{ .PointForce")

cull = CullPattern(List=bhom_3, CullPattern=invert(null.NullFlags))
cull_2 = CullPattern(List=bhomgeo_3, CullPattern=invert(null.NullFlags))
cull_3 = CullPattern(List=bhom_3, CullPattern=null.NullFlags)
isetgeometry = ISetGeometry(Element1D=cull, Curve=cull_2, Component="{ .ISetGeometry")
isetgeometry_2 = ISetGeometry(Element0D=cull, Point=cull_2, Component="{ .ISetGeometry")
isetgeometry_3 = ISetGeometry(Obj=cull, Geometry=cull_2, Component="{ .ISetGeometry")
merge = Merge(Data1=isetgeometry_2, Data2=isetgeometry)
clean = CleanTree(RemoveNulls=True, RemoveInvalid=True, RemoveEmpty=False, Tree=merge)
merge_2 = Merge(Data1=cull_3, Data2=clean)
bhom_6 = BHoMObject(merge_2)

# ----
# Push
bhom_7 = BHoMObject(pointforce)
push_2 = Push(Adapter=bhom, Objects=bhom_7, Active=push.Success, Component="{ .Push")  # -> Objects, Success
