# Grasshopper definition CreateFabricatedBoxSection.gh (Grasshopper 0.9.76)
# plug-ins: Alligator

# ----
# Create Adapter Here
# File Path to reference model file
# Plug structural adapter in to this component.
path = FilePath("C:\Users\pnugent\Desktop\wgsdgh.mdl")

bhom = BHoMObject()

# ----
# Create FabricatedBoxSection
number_slider = Slider(0.07, range=0..0.1)
panel = Panel("Fabricated Box")

fabricatedboxprofile = FabricatedBoxProfile(
    Height=Slider(2, range=0..2),
    Width=Slider(1.2, range=0..2),
    WebThickness=Slider(0.02, range=0..0.1),
    TopFlangeThickness=number_slider,
    BotFlangeThickness=number_slider,
    WeldSize=Slider(0, range=0..0.1),
    Component="{ .FabricatedBoxProfile")
steelsectionfromprofile = SteelSectionFromProfile(Profile=fabricatedboxprofile, Component="{ .SteelSectionFromProfile")
bhom_2 = BHoMObject(steelsectionfromprofile)
push = Push(Adapter=bhom, Objects=bhom_2, Active=Toggle(False), Component="{ .Push")  # -> Objects, Success
