# Grasshopper definition CreateRectangleSection.gh (Grasshopper 0.9.76)
# plug-ins: BH.UI.Grasshopper

# ----
# Adapter
path = FilePath()
bhom = BHoMObject()

# ----
# Create Steel Section
number_slider = Slider(1.1, range=0..2)
steelrectanglesection = SteelRectangleSection(
    Height=number_slider,
    Width=Slider(0.6, range=0..2),
    CornerRadius=0,
    Name="Rectangle Section",
    Component="{ .SteelRectangleSection")

# ----
# Push
toggle = BooleanToggle(False)
bhom_2 = BHoMObject(steelrectanglesection)
push = Push(Adapter=bhom, Objects=bhom_2, Active=toggle)  # -> Objects, Success
