# Grasshopper definition CreateRibbedPanel.gh (Grasshopper 0.9.76)
# plug-ins: BH.UI.Grasshopper

# ----
# Adapter
path = FilePath()

bhom = BHoMObject()
paneldirection = PanelDirection(
    {"X": 0, "Y": 1}, selected="X",
    Component="{ \"_t\" : \"System.Type\", \"Name\" : \"BH.oM.Structure.Properties.Surface.PanelDirection\" }",
    Selection=0)

# ----
# Create SurfaceProperty
number_slider = Slider(1.5, range=0..2)
ribbed = Ribbed(
    Name="Ribbed_Panel",
    SlabDepth=Slider(1.2, range=0..2),
    TotalDepth=Slider(2, range=0..2),
    StemWidth=number_slider,
    Spacing=Slider(1.8, range=0..2),
    Direction=paneldirection,
    Type=null,
    Component="{ .Ribbed")

# ----
# Push
bhom_2 = BHoMObject(ribbed)
push = Push(Adapter=bhom, Objects=bhom_2, Active=Toggle(False))  # -> Objects, Success
