# Grasshopper definition Nodes-with-constraints.gh (Grasshopper 0.9.76)
# plug-ins: BH.UI.Grasshopper

# ----
# Create Adapter Here
path = FilePath()
bhom = BHoMObject()

# ----
# Create Nodes
#  with Constraints
panel = Panel("Pin")
toggle = BooleanToggle(False)
toggle_2 = BooleanToggle(True)
constraint6dof = Constraint6DOF(X=toggle, Y=toggle, Z=toggle, Xx=toggle_2, Yy=toggle_2, Zz=toggle_2, Name=panel, Component="{ .Constraint6DOF")
pt = Point([Point(-1, -2, 0), Point(1, -2, 0), Point(1, 2, 0), Point(-1, 2, 0), Point(-1, -2, 0)])
node = Node(Position=pt, Constraint=constraint6dof, Component="{ .Node")

# ----
# Push Nodes
toggle_3 = BooleanToggle(True)
push = Push(Adapter=bhom, Objects=node, Active=toggle_3, Component="{ .Push")  # -> Objects, Success
