# Grasshopper definition Panels-with-properties.gh (Grasshopper 0.9.76)
# plug-ins: BH.UI.Grasshopper

# ----
# Adapter
path = FilePath()
bhom = BHoMObject(m_ForcePreview=False, m_MaxItemsPreview=10000)

# ----
# Create Material
number_slider = Slider(33000000, range=0..100000000)

steel = Steel(
    Name="Steel",
    E=number_slider,
    V=Slider(0.3, range=0..1),
    TC=1.2e-05,
    Density=Slider(7.5, range=0..10),
    DampingRatio=0,
    YieldStress=0,
    UltimateStress=0,
    Component="{ .Steel")
bhom_2 = BHoMObject(steel, m_ForcePreview=False, m_MaxItemsPreview=10000)

# ----
# Create Surface Property
number_slider_2 = Slider(0.2, range=0..1)
multiplication = Multiplication(A=number_slider_2, B=Slider(1000, range=0..1000))
concat = Concatenate(FragmentA=multiplication, FragmentB="mm")
constantthickness = ConstantThickness(
    Thickness=number_slider_2,
    Material=bhom_2,
    Name=concat,
    Type="{ \"_t\" : \"System.Enum\", \"TypeName\" : { \"_t\" : \"System.Type\", \"Name\" : \"BH.oM.Structure.SurfaceProperties.PanelType\" }, \"Value\" : \"Undefined\" }",
    Component="{ .ConstantThickness")

bhom_3 = BHoMObject(constantthickness, m_ForcePreview=False, m_MaxItemsPreview=10000)

# ----
# Create PanelPlanar
srf = Surface(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)
edges = BrepEdges(Brep=srf)  # -> Naked, Interior, NonManifold
join = JoinCurves(Curves=edges.Naked, Preserve=False)
panel = Panel(Outlines=join, Component="{ .Panel")

bhom_4 = BHoMObject(panel, m_ForcePreview=False, m_MaxItemsPreview=10000)

# ----
# Push
toggle = BooleanToggle(False)
push = Push(Adapter=bhom, Objects=bhom_4, Active=toggle, Component="{ .Push")  # -> Objects, Success
