# Grasshopper definition Pull - TasTBD.gh (Grasshopper 0.9.76)
# plug-ins: BH.UI.Grasshopper

createtype = CreateType(Component="{ \"_t\" : \"System.Type\", \"Name\" : \"BH.oM.Environment.Elements.BuildingElement\" }")
path = FilePath("C:\Users\mdengusi\Desktop\SAM_Bath\2018-11-21 LaundryBHoM\SAM_Live_2zones.tbd")
tastbdadapter = TasTBDAdapter(TBDFilePath=path, Component="{ ..ctor")
filterquery = FilterQuery(Type=createtype, Component="{ .FilterQuery")
pull = Pull(Adapter=tastbdadapter, Query=filterquery, Active=Toggle(True))
